# Grasshopper definition parametric_bench.gh (Grasshopper 1.0.7)

wheel = ColourWheel(
    Slider(2, range=1..3),
    ColourGrips_Style=21,
    ColourGrips_Grip=[1.04837858, 4.189971233, 2.619174906, 5.76076756],
    ColourGrips_Lum=[0.1, 0.8374935126],
    ColourGrips_Range=[0.5527410627, 0.5527410627, 0.5527410627, 0.5527410627],
    ColourGrips_Sat=[0.2, 0.7005788315])
material = CreateMaterial(Diffuse=wheel, Specular=wheel, Emission=wheel, Transparency=0, Shine=0)

brep = Brep(<brep referenced from the Rhino model>)
num = Number(Slider(4, range=0..4))
contour = Contour(Shape=brep, Point=Point(38.1, 0, 0), Direction=Vector(0, 499, 0), Distance=num)
num_2 = Number(0)
num_3 = Number(0)
vec = VectorXYZ(XComponent=num_3, YComponent=Slider(2, range=0..4), ZComponent=num_2)  # -> Vector, Length
vdis = VectorDisplay(Anchor=Point(0, 0.0006274138079, -0.0006274138079), Vector=vec.Vector)
extr = Extrude(Base=contour, Direction=vec.Vector)
cap = CapHoles(Brep=extr)
preview = CustomPreview(Geometry=cap, Material=material)
